# Grasshopper definition Mapping.gh (Grasshopper 1.0.7)
# plug-ins: Parakeet, LunchBox

srf = Surface(<surface referenced from the Rhino model>)
sdivide = DivideSurface(Surface=srf, UCount=10, VCount=10)  # -> Points, Normals, Parameters
flip = FlipMatrix(Data=sdivide.Points)
shift = ShiftList(List=flip, Shift=Slider(1, range=0..10), Wrap=False)  # -> flatten(List)
unroll = UnrollBrep(Brep=srf, JoinUnrolled=False)
number_slider = Slider(5, range=0..10)
intcrv = Interpolate(Vertices=shift, Degree=3, Periodic=False, KnotStyle=1)  # -> Curve, Length, Domain
srf_2 = Surface(unroll)
number_slider_2 = Slider(1, range=0..1)
divdist = DivideDistance(Curve=intcrv.Curve, Distance=number_slider)  # -> Points, Tangents, Parameters
number_slider_3 = Slider(232, range=0..344)
maptosrf = MapToSurface(Curves=intcrv.Curve, SourceSurface=srf, TargetSurface=srf_2, USubdivision=number_slider_2, VSubdivision=number_slider_2)
divdist_2 = DivideDistance(Curve=maptosrf, Distance=number_slider)  # -> Points, Tangents, Parameters
item = ListItem(List=divdist.Points, Index=number_slider_3, Wrap=True)  # -> flatten(Item)
item_2 = ListItem(List=divdist_2.Points, Index=number_slider_3, Wrap=True)  # -> flatten(Item)
number_slider_4 = Slider(7, range=0..10)
panel = Panel(item_2)
points = PointList(Points=item, Size=number_slider_4)
points_2 = PointList(Points=item_2, Size=number_slider_4)

pt = Point(divdist.Points)
points_3 = PointList(Points=pt, Size=Slider(2, range=0..10))
item_3 = ListItem(List=pt, Index=Slider(60, range=0..100), Wrap=True)
pdecon = Deconstruct(Point=pt)  # -> XComponent, YComponent, ZComponent
panel_2 = Panel(pdecon.ZComponent)
panel_3 = Panel(pdecon.XComponent)
panel_4 = Panel(pdecon.YComponent)
format = Format(Format="[{0},{1},{2}]", Culture=127, Data0=pdecon.XComponent, Data1=pdecon.YComponent, Data2=pdecon.ZComponent)
concat = Concatenate(FragmentA="{", FragmentB=panel_3)
panel_5 = Panel(format)
join = TextJoin(Text=panel_5, Join=",")
rec = DataRecorder(DataLimit=-10, RecordData=True)
panel_6 = Panel(join)
format_2 = Format(Format="[{0}]", Culture=127, Data0=panel_6)
panel_7 = Panel(format_2)

pt_2 = Point(divdist_2.Points)
points_4 = PointList(Points=pt_2, Size=Slider(2, range=0..10))
item_4 = ListItem(List=pt_2, Index=Slider(60, range=0..100), Wrap=True)
pdecon_2 = Deconstruct(Point=pt_2)  # -> XComponent, YComponent, ZComponent
panel_8 = Panel(pdecon_2.ZComponent)
panel_9 = Panel(pdecon_2.XComponent)
panel_10 = Panel(pdecon_2.YComponent)
format_3 = Format(Format="[{0},{1},{2}]", Culture=127, Data0=pdecon_2.XComponent, Data1=pdecon_2.YComponent, Data2=pdecon_2.ZComponent)
concat_2 = Concatenate(FragmentA="{", FragmentB=panel_9)
panel_11 = Panel(format_3)
join_2 = TextJoin(Text=panel_11, Join=",")
rec_2 = DataRecorder(DataLimit=-10, RecordData=True)
panel_12 = Panel(join_2)
format_4 = Format(Format="[{0}]", Culture=127, Data0=panel_12)
panel_13 = Panel(format_4)
