# Grasshopper definition Mapping2.gh (Grasshopper 1.0.7)
# plug-ins: Parakeet, LunchBox

number_slider = Slider(50, range=0..100)
srf = Surface(<surface referenced from the Rhino model>)
srf_2 = Surface(<surface referenced from the Rhino model>)
bbox = BoundingBox(Content=srf_2, Plane=PlaneXY(0, 0, 0))  # -> Box, Box_2
debox = DeconstructBox(Box=bbox.Box)  # -> Plane, X, Y, Z
series = Series(Start=debox.Y, Step=1, Count=1)
graph = GraphMapper(
    series,
    x0=0,
    x1=1,
    y0=0,
    y1=1,
    A=1,
    B=0,
    container_name="Linear",
    Graph_x0=0.25,
    Graph_x1=0.75,
    Graph_y0=0.25,
    Graph_y1=0.75)
panel = Panel(graph)
brep = Brep(<brep referenced from the Rhino model>)
bnd = Bounds(Numbers=debox.X)
dedomain = DeconstructDomain(Domain=debox.X)  # -> Start, End
sdivide = DivideSurface(Surface=srf, UCount=number_slider, VCount=number_slider)  # -> Points, Normals, Parameters
dom = ConstructDomain(DomainStart=0, DomainEnd=1)
panel_2 = Panel(dedomain.Start)
flip = FlipMatrix(Data=sdivide.Points)
unroll = UnrollBrep(Brep=srf, JoinUnrolled=False)  # disabled
box = DomainBox(Base=PlaneXY(0, 0, 0), X=graph, Y=debox.Y, Z=debox.Z)
morph = BoxMorph(Geometry=srf_2, Reference=bbox.Box, Target=brep)
number_slider_2 = Slider(5, range=0..10)
shift = ShiftList(List=flip, Shift=Slider(0, range=0..10), Wrap=False)  # -> flatten(List)
srf_3 = Surface(<surface referenced from the Rhino model>)
srf_4 = Surface(<surface referenced from the Rhino model>)
intcrv = Interpolate(Vertices=flip, Degree=3, Periodic=False, KnotStyle=1)  # -> Curve, Length, Domain
orient = Orient(Geometry=srf_2, Source=srf_4, Target=srf_3)  # -> Geometry, Transform
intcrv_2 = Interpolate(Vertices=flip, Degree=3, Periodic=False, KnotStyle=1)  # -> Curve, Length, Domain
srf_5 = Surface(srf)
series_2 = Series(Start=0, Step=1, Count=Slider(120, range=0..555))
srf_6 = Surface(<surface referenced from the Rhino model>)
divide = DivideCurve(Curve=intcrv_2.Curve, Count=10, Kinks=False)  # -> flatten(Points), Tangents, Parameters
number_slider_3 = Slider(1, range=0..1)
item = ListItem(List=divide.Points, Index=series_2, Wrap=True)
number_slider_4 = Slider(232, range=0..344)
maptosrf = MapToSurface(
    Curves=intcrv_2.Curve,
    SourceSurface=srf,
    TargetSurface=srf_6,
    USubdivision=number_slider_3,
    VSubdivision=number_slider_3)
divide_2 = DivideCurve(Curve=maptosrf, Count=10, Kinks=False)  # -> flatten(Points), Tangents, Parameters
item_2 = ListItem(List=divide_2.Points, Index=series_2, Wrap=True)
divdist = DivideDistance(Curve=maptosrf, Distance=number_slider_2)  # -> Points, Tangents, Parameters
item_3 = ListItem(List=flatten(maptosrf), Index=Slider(12, range=0..100), Wrap=True)
item_4 = ListItem(List=item, Index=number_slider_4, Wrap=True)  # -> flatten(Item)
item_5 = ListItem(List=item_2, Index=number_slider_4, Wrap=True)  # -> flatten(Item)
number_slider_5 = Slider(7, range=0..10)
panel_3 = Panel(item_4)
panel_4 = Panel(item_5)
points = PointList(Points=item_4, Size=number_slider_5)
points_2 = PointList(Points=item_5, Size=number_slider_5)
pt = Point(flatten(item_2))
divdist_2 = DivideDistance(Curve=item_3, Distance=number_slider_2)  # -> Points, Tangents, Parameters
orient_2 = Orient(Source=PlaneXY(0, 0, 0), Target=PlaneXY(0, 0, 0))  # -> Geometry, Transform

pt_2 = Point(flatten(item_2))
points_3 = PointList(Points=pt_2, Size=Slider(1, range=0..10))
item_6 = ListItem(List=pt_2, Index=Slider(60, range=0..100), Wrap=True)
pdecon = Deconstruct(Point=pt_2)  # -> XComponent, YComponent, ZComponent
panel_5 = Panel(pdecon.ZComponent)
panel_6 = Panel(pdecon.XComponent)
panel_7 = Panel(pdecon.YComponent)
format = Format(Format="[{0},{1},{2}]", Culture=127, Data0=pdecon.XComponent, Data1=pdecon.YComponent, Data2=pdecon.ZComponent)
concat = Concatenate(FragmentA="{", FragmentB=panel_6)
panel_8 = Panel(format)
join = TextJoin(Text=panel_8, Join=",")
rec = DataRecorder(DataLimit=-10, RecordData=True)
panel_9 = Panel(join)
format_2 = Format(Format="[{0}]", Culture=127, Data0=panel_9)
panel_10 = Panel(format_2)

pt_3 = Point(item)
points_4 = PointList(Points=pt_3, Size=Slider(1, range=0..10))
item_7 = ListItem(List=pt_3, Index=Slider(60, range=0..100), Wrap=True)
pdecon_2 = Deconstruct(Point=pt_3)  # -> XComponent, YComponent, ZComponent
panel_11 = Panel(pdecon_2.ZComponent)
panel_12 = Panel(pdecon_2.XComponent)
panel_13 = Panel(pdecon_2.YComponent)
format_3 = Format(Format="[{0},{1},{2}]", Culture=127, Data0=pdecon_2.XComponent, Data1=pdecon_2.YComponent, Data2=pdecon_2.ZComponent)
concat_2 = Concatenate(FragmentA="{", FragmentB=panel_12)
panel_14 = Panel(format_3)
join_2 = TextJoin(Text=panel_14, Join=",")
rec_2 = DataRecorder(DataLimit=-10, RecordData=True)
panel_15 = Panel(join_2)
format_4 = Format(Format="[{0}]", Culture=127, Data0=panel_15)
panel_16 = Panel(format_4)

pt_4 = Point(flatten(divdist_2.Points))
points_5 = PointList(Points=pt_4, Size=Slider(1, range=0..10))
item_8 = ListItem(List=pt_4, Index=Slider(60, range=0..100), Wrap=True)
pdecon_3 = Deconstruct(Point=pt_4)  # -> XComponent, YComponent, ZComponent
panel_17 = Panel(pdecon_3.ZComponent)
panel_18 = Panel(pdecon_3.XComponent)
panel_19 = Panel(pdecon_3.YComponent)
format_5 = Format(Format="[{0},{1},{2}]", Culture=127, Data0=pdecon_3.XComponent, Data1=pdecon_3.YComponent, Data2=pdecon_3.ZComponent)
concat_3 = Concatenate(FragmentA="{", FragmentB=panel_18)
panel_20 = Panel(format_5)
join_3 = TextJoin(Text=panel_20, Join=",")
rec_3 = DataRecorder(DataLimit=-10, RecordData=True)
panel_21 = Panel(join_3)
format_6 = Format(Format="[{0}]", Culture=127, Data0=panel_21)
panel_22 = Panel(format_6)

join_4 = TextJoin(Text=panel_8, Join=",")
join_5 = TextJoin(Text=panel_20, Join=",")
join_6 = TextJoin(Text=panel_8, Join=",")
join_7 = TextJoin(Text=panel_20, Join=",")
panel_23 = Panel(join_6)
panel_24 = Panel(join_7)
